# Grasshopper definition test_circlemaker.ghx (Grasshopper 0.9.14)

pt = Point()
fuzzmaker = FuzzMaker(pt=pt)
geo = Geometry(fuzzmaker)

# ==== cluster FuzzMaker
pt = ClusterInput()
pt_2 = Point(pt)
cir = Circle(Plane=pt_2, Radius=Slider(5, range=0..10))
divide = DivideCurve(Curve=cir, Count=10, Kinks=False)  # -> Points, Tangents, Parameters
cir_2 = Circle(Plane=divide.Points, Radius=Slider(1, range=0..10))
divide_2 = DivideCurve(Curve=cir_2, Count=10, Kinks=False)  # -> Points, Tangents, Parameters
cir_3 = Circle(Plane=divide_2.Points, Radius=1)
geo = Geometry(cir_3)
geo_2 = ClusterOutput(geo)
