# Grasshopper definition test_decoypointer.ghx (Grasshopper 0.9.14)

pt = Point()
slider = Slider(18, range=0..100)
pt_2 = Point(pt)
cluster = Cluster(P=pt_2)  # -> R_2, R
dom = Domain(DomainStart=Slider(0.28, range=-1..1), DomainEnd=Slider(1, range=-1..1))
domain = Domain(Domain(0, 6.283185307))
slider_2 = Slider(0, range=0..100)
random = Random(Range=dom, Number=slider, Seed=cluster.R)
random_2 = Random(Range=domain, Number=slider, Seed=cluster.R_2)
pt_3 = PointPolar(BasePlane=pt_2, XYAngle=random_2, ZAngle=0, Offset=random)
pt_4 = Point(pt_3)
pt_5 = Point(pt_4)

# ==== cluster Cluster
P = ClusterInput()
pcomp = Decompose(Point=P, System=PlaneXY(0, 0, 0))  # -> XComponent, YComponent, ZComponent
ma = MassAddition(Input=[pcomp.ZComponent, pcomp.YComponent, pcomp.XComponent])  # -> Result, PartialResults
R = ClusterOutput(ma.Result)
mm = MassMultiplication(Input=[pcomp.ZComponent, pcomp.YComponent, pcomp.XComponent])  # -> Result, PartialResults
R_2 = ClusterOutput(mm.Result)
