# Grasshopper definition test_fuzzmaker.ghx (Grasshopper 0.9.14)

pt = Point()
fuzzmaker = FuzzMaker(pt=pt)
geo = Geometry(fuzzmaker)

# ==== cluster FuzzMaker
pt = ClusterInput()
slider = Slider(69, range=0..100)
pt_2 = Point(pt)
division = Division(A=Slider(360, range=0..1000), B=slider)
X = UnitX(Factor=1)
line = LineSDL(Start=pt_2, Direction=X, Length=Slider(10, range=0..10))
series = Series(Start=0, Step=division, Count=slider)
xy = XYPlane(Origin=pt_2)
rad = Radians(Degrees=series)
rotate = Rotate(Geometry=line, Angle=rad, Plane=xy)  # -> Geometry, Transform
geo = Geometry(rotate.Geometry)
geo_2 = ClusterOutput(geo)
